# Grasshopper definition TestSanke.gh (Grasshopper 1.0.8)
# plug-ins: Marmoset

panel = Panel("""0
1
2
3""")
cull_pattern = CullPattern(List=panel, CullPattern=[Button(), Button(), Button(), Button()])
snake = Snake(Width=20, Height=20, Direction=cull_pattern, Start=Toggle(False), Reset=Button(), Seed=0, Wrap=True)  # -> Snake, Food, Score, Alive, Status, Boundary
panel_2 = Panel(snake.Status)
panel_3 = Panel(snake.Score)
panel_4 = Panel(snake.Alive)
